% Simulink data dictionary DoorLockCntr.sldd

DiagCntVal = Simulink.Parameter(20, StorageClass="ConstVolatile", DataType="uint8")
SpeedCntVal = Simulink.Parameter(20, StorageClass="ConstVolatile", DataType="uint8")
DiagCnt = Simulink.Signal(StorageClass="FileScope", DataType="uint8")
DLockCmd_prev = Simulink.Signal(StorageClass="FileScope", DataType="boolean")
SpeedCnt = Simulink.Signal(StorageClass="FileScope", DataType="uint8")
DLockDiag = Simulink.Signal(StorageClass="ExportedGlobal", DataType="Enum: DiagStatus")
Speed = Simulink.Signal(StorageClass="ImportedExtern", DataType="single")
LeftDPos = Simulink.Signal(StorageClass="ImportedExtern", DataType="single")
RightDPos = Simulink.Signal(StorageClass="ImportedExtern", DataType="single")
EngStart = Simulink.Signal(StorageClass="ImportedExtern", DataType="boolean")
AirBagOn = Simulink.Signal(StorageClass="ImportedExtern", DataType="boolean")
DLockCmd = Simulink.Signal(StorageClass="ExportedGlobal", DataType="boolean")
SpeedTh = Simulink.Parameter(5, StorageClass="ConstVolatile", DataType="single")