test file "DoorLockCntr_test_mgr"
  coverage: Decision, MCDC, Condition

suite "機能テスト：入力・出力期待値比較"

  case "Normal1" [baseline]
    model DoorLockCntr, harness DoorLockCntr_Harness1
    input "DoorLockCntr_timing_chart_wtype.xlsx", sheet NORMAL1, mapped to Speed, EngStart, AirBagOn, LeftDPos, RightDPos (active)
    logged signals "信号セット 1": Speed, AirBagOn, LeftDPos, RightDPos, DLockDiag, EngStart, DLockCmd
    baseline "DoorLockCntr_timing_chart_wtype.xlsx"
      Speed
      EngStart
      AirBagOn
      LeftDPos
      RightDPos
      DLockCmd
      DLockDiag

  case "Normal2" [baseline]
    model DoorLockCntr, harness DoorLockCntr_Harness1
    input "DoorLockCntr_timing_chart_wtype.xlsx", sheet NORMAL2, mapped to Speed, EngStart, AirBagOn, LeftDPos, RightDPos (active)
    logged signals "信号セット 1": Speed, AirBagOn, LeftDPos, RightDPos, DLockDiag, EngStart, DLockCmd
    baseline "DoorLockCntr_timing_chart_wtype.xlsx"
      Speed
      EngStart
      AirBagOn
      LeftDPos
      RightDPos
      DLockCmd
      DLockDiag

  case "Fail1" [baseline]
    model DoorLockCntr, harness DoorLockCntr_Harness1
    input "DoorLockCntr_timing_chart_wtype.xlsx", sheet FAIL1, mapped to Speed, EngStart, AirBagOn, LeftDPos, RightDPos (active)
    logged signals "信号セット 1": Speed, AirBagOn, LeftDPos, RightDPos, DLockDiag, EngStart, DLockCmd
    baseline "DoorLockCntr_timing_chart_wtype.xlsx"
      Speed
      EngStart
      AirBagOn
      LeftDPos
      RightDPos
      DLockCmd
      DLockDiag

  case "Fail2" [baseline]
    model DoorLockCntr, harness DoorLockCntr_Harness1
    input "DoorLockCntr_timing_chart_wtype.xlsx", sheet FAIL2, mapped to Speed, EngStart, AirBagOn, LeftDPos, RightDPos (active)
    logged signals "信号セット 1": Speed, AirBagOn, LeftDPos, RightDPos, DLockDiag, EngStart, DLockCmd
    baseline "DoorLockCntr_timing_chart_wtype.xlsx"
      Speed
      EngStart
      AirBagOn
      LeftDPos
      RightDPos
      DLockCmd
      DLockDiag